# Dynamo graph DShapeFinishing  - Создать DS по Face (для имени DS выбрать в ревите пример).dyn "DShapeFinishing - Создать DS по Face (для имени DS выбрать в ревите пример)" (Dynamo 2.3.0.5885)

# group: ЭЛЕМЕНТЫ УПРАВЛЕНИЯ MAIN
# note: ПЕРЕМЕННЫЕ ЗНАЧЕНИЯ
# note: ЭЛЕМЕНТЫ УПРАВЛЕНИЯ

# group: ПОЛУЧАЕМ ДАННЫЕ
# note: ПОЛУЧАЕМ ДАННЫЕ ИЗ РЕВИТ и других источников

# group: ПРОВЕРОЧНЫЕ НОДЫ
# note: ПРОВЕРОЧНЫЕ НОДЫ

# group: КЛЮЧЕВЫЕ МОМЕНТЫ РАБОТЫ 1
# note: КОНСОЛИДАЦИЯ И СЛОЖНЫЕ ОБРАБОТКИ

# group: ИСПОЛНИТЕЛЬНЫЕ НОДЫ (фильтрование, подбор, списки и т.д.)
# note: ИСПОЛНИТЕЛЬНЫЕ НОДЫ

# group: СОЗДАЁМ ДАННЫЕ
# note: ПЕРЕДАЁМ ИНФОРМАЦИЮ В РЕВИТ
# note: ПЕРЕДАЁМ ИНФОРМАЦИЮ ЕЩЁ КУДА-ТО

# group: ЗАПАСНЫЕ ВАРИАНТЫ, ДОПОЛНИТЕЛЬНЫЕ ОПЦИИ
# note: ЗАПАСНЫЕ

# group: ПРИМЕЧАНИЯ ПО ЦВЕТОВОЙ ГРУППИРОВКЕ
# note: GUIDELINES

# group: КЛЮЧЕВЫЕ МОМЕНТЫ РАБОТЫ 2
# note: УСЛОЖНЕННЫЕ КОНСТРУКЦИИ
# note: УСЛОЖНЕНЫЕ КОНСТРУКЦИИ

# group: Python ноды
# note: Python

# group: ЭЛЕМЕНТЫ УПРАВЛЕНИЯ SECOND
# note: ЭЛЕМЕНТЫ УПРАВЛЕНИЯ
# note: ПЕРЕМЕННЫЕ ЗНАЧЕНИЯ

# group: Запуск питона из внешнего файла
# note: Py - files

# group: Create raster image on face
# note: GUIDELINES

# group: Create raster image on face
# note: GUIDELINES

# group: SOME STUFF
# note: GUIDELINES

# group: Change DS material (recreate DS)
# note: GUIDELINES

создать_ds = BoolSelector(false)  # graph input
select_faces = SelectFaces()  # 3 picked in the model
boundingBox = Geometry.BoundingBox(geometry=select_faces)
flatten = List.Flatten(list=boundingBox)
подрезка_снизу_мм = StringInput("0")  # graph input

# group: Подрезка снизу
minPoint = BoundingBox.MinPoint(boundingBox=flatten)
Z = Point.Z(point=minPoint)
toNumber = String.ToNumber(str=подрезка_снизу_мм)
add = Z + toNumber
byOrigin = CoordinateSystem.ByOrigin(z=add)
XYPlane = CoordinateSystem.XYPlane(coordinateSystem=byOrigin)
split = Geometry.Split(geometry=select_faces, other=XYPlane)
code_block = CodeBlock { 0; }
getItemAtIndex = List.GetItemAtIndex(list=split@L2, index=code_block)

подрезка_сверху_мм = StringInput("0")  # graph input

# group: Подрезка сверху, мм
maxPoint = BoundingBox.MaxPoint(boundingBox=flatten)
Z_2 = Point.Z(point=maxPoint)
toNumber_2 = String.ToNumber(str=подрезка_сверху_мм)
sub = Z_2 - toNumber_2
byOrigin_2 = CoordinateSystem.ByOrigin(z=sub)
XYPlane_2 = CoordinateSystem.XYPlane(coordinateSystem=byOrigin_2)
split_2 = Geometry.Split(geometry=getItemAtIndex, other=XYPlane_2)

# group: EXCEPT if list len > 1 (if cut = 0)
firstItem = List.FirstItem(list=split_2)
count = List.Count(list=firstItem)
code_block_2 = CodeBlock { 1; }
gt = count > code_block_2
code_block_3 = CodeBlock { 1; 0; }
if_ = If(test=gt, true=code_block_3.out0, false=code_block_3.out1)

# group (continued): Подрезка сверху, мм
getItemAtIndex_2 = List.GetItemAtIndex(list=split_2@L2, index=if_)

code_block_4 = CodeBlock { null; }
if_2 = Python(IN[0]=создать_ds, IN[1]=getItemAtIndex_2, IN[2]=code_block_4)
# ---------- if_2.python (4 lines) ----------
if IN[0]:
	OUT = IN[1]
else:
	OUT = IN[2]
# ----------------------------------------

# group: !RUN FIRST! SELECT MATERIAL
categories = Categories("OST_Materials")
all_elements_of_category = ElementsOfCategory(Category=categories)
material_index_for_ds = CodeBlock { 246; }
getItemAtIndex_3 = List.GetItemAtIndex(list=all_elements_of_category, index=material_index_for_ds)
name = Material.Name(material=getItemAtIndex_3)
name_2 = Material.Name(material=all_elements_of_category)
all_material_index = Watch(name_2)

# group: CREATE DIRECTSHAPES
категория_для_добавления_ds = Categories("OST_Walls")  # graph input
code_block_5 = CodeBlock(material=getItemAtIndex_3) { material; }
code_block_6 = CodeBlock(name=name) { name; }
byGeometry = DirectShape.ByGeometry(geometry=if_2@L1, category=категория_для_добавления_ds, material=code_block_5, name=code_block_6)  # frozen
имя_материала = StringInput("ADSK_Бетон_Железобетон")  # graph input
byName = Material.ByName(name=имя_материала)

color_palette = ColorPalette({R: 0, G: 250, B: 154, A: 255})
byGeometryColor = Modifiers.GeometryColor.ByGeometryColor(geometry=getItemAtIndex_2, color=color_palette)
color_palette_2 = ColorPalette({R: 238, G: 130, B: 238, A: 255})
byGeometryColor_2 = Modifiers.GeometryColor.ByGeometryColor(geometry=select_faces, color=color_palette_2)

# group: Select Face
select_face = DSFaceSelection()  # 1 picked in the model; graph input; frozen

# group: Select Raster
file_path = Filename("D:\data\BIM\Monro_4colors.png")  # frozen

# group: quality
quality_1_high_10_low = IntegerSlider(10, range=1..10 step 1)

# group: GET COLORS FROM IMAGE
file_from_path = FileObject(path=file_path)
readFromFile = Image.ReadFromFile(file=file_from_path)
dimensions = Image.Dimensions(image=readFromFile)
code_block_7 = CodeBlock(a=quality_1_high_10_low, x=dimensions.width, y=dimensions.height) { a; Math.Round(x/a); Math.Round(y/a); }
pixels = Image.Pixels(image=readFromFile, xSamples=code_block_7.out1, ySamples=code_block_7.out2)
flatten_2 = List.Flatten(list=pixels)

# group: IMAGE ON DYNAMO SURFACE
bySurfaceColors = Modifiers.GeometryColor.BySurfaceColors(surface=select_face, colors=pixels)

code_block_8 = CodeBlock(y=code_block_7.out2) { 1..y; }
code_block_9 = CodeBlock(x=code_block_7.out1) { 1..x; }
byCoordinates = Point.ByCoordinates(x=code_block_8, y=code_block_9, lacing=CrossProduct)  # frozen
red = Color.Red(color=flatten_2)
green = Color.Green(color=flatten_2)
blue = Color.Blue(color=flatten_2)
code_block_10 = CodeBlock(r=red, g=green, b=blue) { r+g+b; }
code_block_11 = CodeBlock(rgb=code_block_10) { rgb/100; }  # frozen
code_block_12 = CodeBlock { 1; }
round = Math.Round(number=code_block_11, digits=code_block_12)
code_block_13 = CodeBlock(rgb=round) { rgb*2; }
round_2 = Math.Round(number=code_block_13)
translate = Geometry.Translate(geometry=byCoordinates, zTranslation=round_2)  # frozen
byGeometryColor_3 = Modifiers.GeometryColor.ByGeometryColor(geometry=translate, color=pixels)  # frozen
code_block_14 = CodeBlock(x=code_block_13) { x/5; }
code_block_15 = CodeBlock(base_points=byCoordinates) { base_points; }  # frozen
firstItem_2 = List.FirstItem(list=code_block_15)
byPoints = PolyCurve.ByPoints(points=firstItem_2)
lastItem = List.LastItem(list=code_block_15)
byPoints_2 = PolyCurve.ByPoints(points=lastItem)
transpose = List.Transpose(lists=code_block_15)
firstItem_3 = List.FirstItem(list=transpose)
byPoints_3 = PolyCurve.ByPoints(points=firstItem_3)
lastItem_2 = List.LastItem(list=transpose)
byPoints_4 = PolyCurve.ByPoints(points=lastItem_2)
list_create = List.Create(item0=byPoints, item1=byPoints_2, item2=byPoints_3, item3=byPoints_4)
byJoinedCurves = PolyCurve.ByJoinedCurves(curves=list_create)
byPatch = Surface.ByPatch(closedCurve=byJoinedCurves)
code_block_16 = CodeBlock(moved_points=translate) { moved_points; }  # frozen
firstItem_4 = List.FirstItem(list=code_block_16)
reverse = List.Reverse(list=firstItem_4)
list_create_2 = List.Create(item0=firstItem_2, item1=reverse)
flatten_3 = List.Flatten(list=list_create_2)
byPerimeterPoints = Surface.ByPerimeterPoints(points=flatten_3)
lastItem_3 = List.LastItem(list=code_block_16)
reverse_2 = List.Reverse(list=lastItem_3)
list_create_3 = List.Create(item0=lastItem, item1=reverse_2)
flatten_4 = List.Flatten(list=list_create_3)
byPerimeterPoints_2 = Surface.ByPerimeterPoints(points=flatten_4)
transpose_2 = List.Transpose(lists=code_block_16)
firstItem_5 = List.FirstItem(list=transpose_2)
reverse_3 = List.Reverse(list=firstItem_5)
list_create_4 = List.Create(item0=firstItem_3, item1=reverse_3)
flatten_5 = List.Flatten(list=list_create_4)
byPerimeterPoints_3 = Surface.ByPerimeterPoints(points=flatten_5)
lastItem_4 = List.LastItem(list=transpose_2)
reverse_4 = List.Reverse(list=lastItem_4)
list_create_5 = List.Create(item0=lastItem_2, item1=reverse_4)
flatten_6 = List.Flatten(list=list_create_5)
byPerimeterPoints_4 = Surface.ByPerimeterPoints(points=flatten_6)
integer_slider = IntegerSlider(1, range=1..10 step 1)
byControlPoints = NurbsSurface.ByControlPoints(controlVertices=translate, uDegree=integer_slider, vDegree=integer_slider)
list_create_6 = List.Create(item0=byPatch, item1=byPerimeterPoints, item2=byPerimeterPoints_2, item3=byPerimeterPoints_3, item4=byPerimeterPoints_4, item5=byControlPoints)
byJoinedSurfaces = Solid.ByJoinedSurfaces(facesOfSolid=list_create_6)
volume = Solid.Volume(solid=byJoinedSurfaces)

# group: CREATE POINT CLOUD ON SURFACE
code_block_17 = CodeBlock(x=code_block_7.out1, y=code_block_7.out2) { x; 1/x; y; 1/y; }
sequence = Sequence(amount=code_block_17.y, step=code_block_17.out3)
sequence_2 = Sequence(amount=code_block_17.x, step=code_block_17.out1)
pointAtParameter = Surface.PointAtParameter(surface=select_face, u=sequence, v=sequence_2, lacing=CrossProduct)

# group: GROUP POINTS BY COLOR
flatten_7 = List.Flatten(list=pointAtParameter)
flatten_8 = List.Flatten(list=flatten_2)
groupByKey = List.GroupByKey(list=flatten_7, keys=flatten_8)
flatten_9 = List.Flatten(list=pixels)
groupByKey_2 = List.GroupByKey(list=flatten_9, keys=flatten_8)

# group: POINT GROUP BY INDEX
integer_slider_2 = IntegerSlider(2, range=1..10 step 1)
getItemAtIndex_4 = List.GetItemAtIndex(list=groupByKey.groups, index=integer_slider_2)

# group: POINT TO POINT DISTANCE IN CLOUD
firstItem_6 = List.FirstItem(list=pointAtParameter)
firstItem_7 = List.FirstItem(list=firstItem_6)
code_block_18 = CodeBlock { 0; 1; }
getItemAtIndex_5 = List.GetItemAtIndex(list=firstItem_7, index=code_block_18.out0)
getItemAtIndex_6 = List.GetItemAtIndex(list=firstItem_7, index=code_block_18.out1)
distanceTo = Geometry.DistanceTo(geometry=getItemAtIndex_5, other=getItemAtIndex_6)
getItemAtIndex_7 = List.GetItemAtIndex(list=firstItem_6, index=code_block_18.out1)
getItemAtIndex_8 = List.GetItemAtIndex(list=getItemAtIndex_7, index=code_block_18.out0)
distanceTo_2 = Geometry.DistanceTo(geometry=getItemAtIndex_5, other=getItemAtIndex_8)

# group: CREATE CUBOID BY POITNS
byLengths = Cuboid.ByLengths(origin=groupByKey.groups, width=distanceTo, length=distanceTo, height=distanceTo_2)
byUnion = Solid.ByUnion(solids=byLengths)
firstItem_8 = List.FirstItem(list=groupByKey_2.groups@L2)

byGeometryColor_4 = Modifiers.GeometryColor.ByGeometryColor(geometry=byUnion, color=firstItem_8)
code_block_19 = CodeBlock(rgb=red) { Math.Round(rgb / 10)*10; }
python_script = Python(IN[0]=code_block_19)
# ---------- python_script.python (1 lines) ----------
OUT = [str(int(i)) for i in IN[0]] 
# ----------------------------------------
code_block_20 = CodeBlock(rgb=green) { Math.Round(rgb / 10)*10; }
python_script_2 = Python(IN[0]=code_block_20)  # same code as python_script
code_block_21 = CodeBlock(rgb=blue) { Math.Round(rgb / 10)*10; }
python_script_3 = Python(IN[0]=code_block_21)  # same code as python_script
code_block_22 = CodeBlock(r=python_script, g=python_script_2, b=python_script_3) { r+g+b; }
uniqueItems = List.UniqueItems(list=code_block_22)

# group: Revit Disposier
boolean = BoolSelector(false)
python_script_4 = Python(IN[0]=boolean)
# ---------- python_script_4.python (22 lines) ----------
# Загрузить стандартную библиотеку Python и библиотеку DesignScript
import sys
import clr
import gc
import ctypes
import System
from System.Diagnostics import Process

output = []
output.append(" === Garbage Collector Start === ")
process_list = ["Revit", "Revit.exe", "Autodesk Revit"]
clear = ctypes.windll.kernel32.K32EmptyWorkingSet
all_proceses = [Process.GetProcessesByName(procs) for procs in process_list]
process_counter = sum([len(procs) for procs in all_proceses])
output.append(" === Process find: {} === ".format(process_counter))
clear_proceses_k = [clear(p.Handle) for procs in all_proceses for p in procs]
clear_proceses_d = [p.Dispose() for procs in all_proceses for p in procs]
del process_list, clear, all_proceses, clear_proceses_k
gc.collect()
output.append(" === Garbage Collector End === ")

OUT = output
# ----------------------------------------

# group: CREATE DIRECTSHAPE (and material)
категория_для_добавления_ds_2 = Categories("OST_Walls")  # graph input
RESET = BoolSelector(false)
create_material_by_color_rgb = Python(IN[0]=groupByKey.unique_keys, IN[1]=RESET)
# ---------- create_material_by_color_rgb.python (39 lines) ----------
import sys
import clr
clr.AddReference("RevitServices")
from RevitServices.Persistence import DocumentManager
from RevitServices.Transactions import TransactionManager
clr.AddReference('RevitAPI')
import Autodesk
from Autodesk.Revit.DB import FilteredElementCollector, Material, Color
import System
from System import Byte


def create_or_get_material(current_doc, mat_name, color):
	"""Create material, or find exist, by name."""
	if Material.IsNameUnique(current_doc, mat_name):
		new_mat_id = Material.Create(current_doc, mat_name)
		new_mat = current_doc.GetElement(new_mat_id)
		new_mat.Color = Autodesk.Revit.DB.Color(Byte.Parse(str(color.Red)), Byte.Parse(str(color.Green)), Byte.Parse(str(color.Blue)))
		return new_mat
	else:
		all_materials = FilteredElementCollector(current_doc).OfClass(Material).ToElements()
		for material in all_materials:
			if material.Name == mat_name:
				return material
	return None
	
colors = UnwrapElement(IN[0])

current_doc = DocumentManager.Instance.CurrentDBDocument

materials = []

TransactionManager.Instance.EnsureInTransaction(current_doc)
for color in colors:
	mat = create_or_get_material(current_doc, str(color), color)
	materials.append(mat)
TransactionManager.Instance.ForceCloseTransaction()

OUT = materials
# ----------------------------------------
string_from_object = FromObject(obj=groupByKey.unique_keys)
byGeometry_2 = DirectShape.ByGeometry(geometry=byUnion, category=категория_для_добавления_ds_2, material=create_material_by_color_rgb, name=string_from_object)

minPoint_2 = BoundingBox.MinPoint(boundingBox=flatten)  # frozen
byOriginNormal = Plane.ByOriginNormal(origin=minPoint_2)
code_block_23 = CodeBlock { 500; }
translate_2 = Geometry.Translate(geometry=byOriginNormal, zTranslation=code_block_23)
list_create_7 = List.Create(item0=translate_2)
изменить_материал_ds = BoolSelector(true)  # graph input

# group: Get Revit Selection:
pys_get_revit_selection = Python()  # unwired: IN[0]
# ---------- pys_get_revit_selection.python (22 lines) ----------
import clr
clr.AddReference('RevitServices')
clr.AddReference('RevitAPI')
from Autodesk.Revit.DB import *
import RevitServices
from RevitServices.Persistence import DocumentManager
from Autodesk.Revit.ApplicationServices import Application

reset = IN[0]

doc = DocumentManager.Instance.CurrentDBDocument
uidoc = DocumentManager.Instance.CurrentUIApplication.ActiveUIDocument
ids = uidoc.Selection.GetElementIds()

idd = [str(i) for i in ids]

if isinstance(idd, list) == True:
	elems = [doc.GetElement(ElementId(int(i))) for i in idd]
else:
	elems = doc.GetElement(ElementId(int(idd)))

OUT = elems
# ----------------------------------------

code_block_24 = CodeBlock { null; }
if_3 = Python(IN[0]=изменить_материал_ds, IN[1]=pys_get_revit_selection, IN[2]=code_block_24)
# ---------- if_3.python (12 lines) ----------
import clr
boolean = IN[0]
true = UnwrapElement(IN[1])
false = UnwrapElement(IN[2])

if boolean:
	out = true
else:
	out = false

#Назначьте вывод переменной OUT.
OUT = out
# ----------------------------------------
имя_материала_2 = StringInput("АБН_Отделка стен железобетон(Автостоянка)")  # graph input

# group: Создаём ДиректШейп и применяем материал
faces = Element.Faces(element=if_3)
flatten_10 = List.Flatten(list=faces)
категория_для_добавления_ds_3 = Categories("OST_Parts")  # graph input
byName_2 = Material.ByName(name=имя_материала_2)
name_3 = Element.Name(element=if_3)
byGeometry_3 = DirectShape.ByGeometry(geometry=flatten_10@L1, category=категория_для_добавления_ds_3, material=byName_2, name=name_3)
flatten_11 = List.Flatten(list=byGeometry_3)
create = List.Create(item0=if_3, item1=flatten_11)
code_block_25 = CodeBlock { "АБН_Отделка стен железобетон(Автостоянка)"; "АБН_Отделка стен кладка(Автостоянка)"; }

end = Revit.Transaction.Transaction.End(input=create)
start = Revit.Transaction.Transaction.Start(input=end)
code_block_26 = CodeBlock(list=start) { list[0]; }
delete = Element.Delete(element=code_block_26)
split_3 = Geometry.Split(geometry=getItemAtIndex_2, other=translate_2)
getMaterials = Element.GetMaterials()  # unwired: element
select_model_element = DSModelElementSelection()  # 1 picked in the model
name_4 = Element.Name(element=select_model_element)
faces_2 = Element.Faces(element=name_4)
