# Dynamo graph DShapeFinishing  - Создать DS по Face.dyn "DShapeFinishing - Создать DS по Face" (Dynamo 2.3.0.5885)

# group: ПРИМЕЧАНИЯ ПО ЦВЕТОВОЙ ГРУППИРОВКЕ
# note: GUIDELINES

# group: ПОЛУЧАЕМ ДАННЫЕ
# note: ПОЛУЧАЕМ ДАННЫЕ ИЗ РЕВИТ и других источников

# group: ПРОВЕРОЧНЫЕ НОДЫ
# note: ПРОВЕРОЧНЫЕ НОДЫ

# group: КЛЮЧЕВЫЕ МОМЕНТЫ РАБОТЫ 1
# note: КОНСОЛИДАЦИЯ И СЛОЖНЫЕ ОБРАБОТКИ

# group: ИСПОЛНИТЕЛЬНЫЕ НОДЫ (фильтрование, подбор, списки и т.д.)
# note: ИСПОЛНИТЕЛЬНЫЕ НОДЫ

# group: СОЗДАЁМ ДАННЫЕ
# note: ПЕРЕДАЁМ ИНФОРМАЦИЮ В РЕВИТ
# note: ПЕРЕДАЁМ ИНФОРМАЦИЮ ЕЩЁ КУДА-ТО

# group: ЗАПАСНЫЕ ВАРИАНТЫ, ДОПОЛНИТЕЛЬНЫЕ ОПЦИИ
# note: ЗАПАСНЫЕ

# group: КЛЮЧЕВЫЕ МОМЕНТЫ РАБОТЫ 2
# note: УСЛОЖНЕННЫЕ КОНСТРУКЦИИ
# note: УСЛОЖНЕНЫЕ КОНСТРУКЦИИ

# group: Python ноды
# note: Python

# group: ЭЛЕМЕНТЫ УПРАВЛЕНИЯ SECOND
# note: ЭЛЕМЕНТЫ УПРАВЛЕНИЯ
# note: ПЕРЕМЕННЫЕ ЗНАЧЕНИЯ

# group: Запуск питона из внешнего файла
# note: Py - files

# group: Create raster image on face
# note: GUIDELINES

# group: Create DirectShape by face`s
# note: GUIDELINES

# group: SOME STUFF
# note: GUIDELINES

# group: Change DS material (recreate DS)
# note: GUIDELINES

# group: ЭЛЕМЕНТЫ УПРАВЛЕНИЯ MAIN
# note: ПЕРЕМЕННЫЕ ЗНАЧЕНИЯ

# group: SELECT FACES set botom and/or top cut
select_faces = SelectFaces()  # 1 picked in the model
подрезка_снизу_мм = StringInput("0")  # graph input
подрезка_сверху_мм = StringInput("0")  # graph input

boundingBox = Geometry.BoundingBox(geometry=select_faces)
flatten = List.Flatten(list=boundingBox)

# group: Подрезка снизу
minPoint = BoundingBox.MinPoint(boundingBox=flatten)
Z = Point.Z(point=minPoint)
toNumber = String.ToNumber(str=подрезка_снизу_мм)
add = Z + toNumber
byOrigin = CoordinateSystem.ByOrigin(z=add)
XYPlane = CoordinateSystem.XYPlane(coordinateSystem=byOrigin)
split = Geometry.Split(geometry=select_faces, other=XYPlane)
code_block = CodeBlock { 0; }
getItemAtIndex = List.GetItemAtIndex(list=split@L2, index=code_block)

# group: Подрезка сверху, мм
maxPoint = BoundingBox.MaxPoint(boundingBox=flatten)
Z_2 = Point.Z(point=maxPoint)
toNumber_2 = String.ToNumber(str=подрезка_сверху_мм)
sub = Z_2 - toNumber_2
byOrigin_2 = CoordinateSystem.ByOrigin(z=sub)
XYPlane_2 = CoordinateSystem.XYPlane(coordinateSystem=byOrigin_2)
split_2 = Geometry.Split(geometry=getItemAtIndex, other=XYPlane_2)

# group: EXCEPT if list len > 1 (if cut = 0)
firstItem = List.FirstItem(list=split_2)
count = List.Count(list=firstItem)
code_block_2 = CodeBlock { 1; }
gt = count > code_block_2
code_block_3 = CodeBlock { 1; 0; }
if_ = If(test=gt, true=code_block_3.out0, false=code_block_3.out1)

# group (continued): Подрезка сверху, мм
getItemAtIndex_2 = List.GetItemAtIndex(list=split_2@L2, index=if_)

# group: Color cheker
color_palette = ColorPalette({R: 0, G: 250, B: 154, A: 255})
byGeometryColor = Modifiers.GeometryColor.ByGeometryColor(geometry=getItemAtIndex_2, color=color_palette)
color_palette_2 = ColorPalette({R: 238, G: 130, B: 238, A: 255})
byGeometryColor_2 = Modifiers.GeometryColor.ByGeometryColor(geometry=select_faces, color=color_palette_2)

# group: quality
quality_1_high_10_low_20_wery = IntegerSlider(20, range=1..20 step 1)  # "quality: 1-high ... 10-low ... 20-wery low"

# group: Select Raster
file_path = Filename("D:\data\BIM\Monro_4colors_180.png")

# group: GET COLORS FROM IMAGE
file_from_path = FileObject(path=file_path)
readFromFile = Image.ReadFromFile(file=file_from_path)
dimensions = Image.Dimensions(image=readFromFile)
code_block_4 = CodeBlock(a=quality_1_high_10_low_20_wery, x=dimensions.width, y=dimensions.height) { a; Math.Ceiling(x/a); Math.Ceiling(y/a); }
pixels = Image.Pixels(image=readFromFile, xSamples=code_block_4.out1, ySamples=code_block_4.out2)

code_block_5 = CodeBlock(y=code_block_4.out2) { 1..y; }
code_block_6 = CodeBlock(x=code_block_4.out1) { 1..x; }
byCoordinates = Point.ByCoordinates(x=code_block_5, y=code_block_6, lacing=CrossProduct)  # frozen
flatten_2 = List.Flatten(list=pixels)  # frozen
red = Color.Red(color=flatten_2)
green = Color.Green(color=flatten_2)
blue = Color.Blue(color=flatten_2)
code_block_7 = CodeBlock(r=red, g=green, b=blue) { r+g+b; }
code_block_8 = CodeBlock(rgb=code_block_7) { rgb/100; }  # frozen
code_block_9 = CodeBlock { 1; }
round = Math.Round(number=code_block_8, digits=code_block_9)
code_block_10 = CodeBlock(rgb=round) { rgb*2; }
round_2 = Math.Round(number=code_block_10)
translate = Geometry.Translate(geometry=byCoordinates, zTranslation=round_2)  # frozen
byGeometryColor_3 = Modifiers.GeometryColor.ByGeometryColor(geometry=translate, color=pixels)  # frozen
code_block_11 = CodeBlock(x=code_block_10) { x/5; }
code_block_12 = CodeBlock(base_points=byCoordinates) { base_points; }  # frozen
firstItem_2 = List.FirstItem(list=code_block_12)
byPoints = PolyCurve.ByPoints(points=firstItem_2)
lastItem = List.LastItem(list=code_block_12)
byPoints_2 = PolyCurve.ByPoints(points=lastItem)
transpose = List.Transpose(lists=code_block_12)
firstItem_3 = List.FirstItem(list=transpose)
byPoints_3 = PolyCurve.ByPoints(points=firstItem_3)
lastItem_2 = List.LastItem(list=transpose)
byPoints_4 = PolyCurve.ByPoints(points=lastItem_2)
list_create = List.Create(item0=byPoints, item1=byPoints_2, item2=byPoints_3, item3=byPoints_4)
byJoinedCurves = PolyCurve.ByJoinedCurves(curves=list_create)
byPatch = Surface.ByPatch(closedCurve=byJoinedCurves)
code_block_13 = CodeBlock(moved_points=translate) { moved_points; }  # frozen
firstItem_4 = List.FirstItem(list=code_block_13)
reverse = List.Reverse(list=firstItem_4)
list_create_2 = List.Create(item0=firstItem_2, item1=reverse)
flatten_3 = List.Flatten(list=list_create_2)
byPerimeterPoints = Surface.ByPerimeterPoints(points=flatten_3)
lastItem_3 = List.LastItem(list=code_block_13)
reverse_2 = List.Reverse(list=lastItem_3)
list_create_3 = List.Create(item0=lastItem, item1=reverse_2)
flatten_4 = List.Flatten(list=list_create_3)
byPerimeterPoints_2 = Surface.ByPerimeterPoints(points=flatten_4)
transpose_2 = List.Transpose(lists=code_block_13)
firstItem_5 = List.FirstItem(list=transpose_2)
reverse_3 = List.Reverse(list=firstItem_5)
list_create_4 = List.Create(item0=firstItem_3, item1=reverse_3)
flatten_5 = List.Flatten(list=list_create_4)
byPerimeterPoints_3 = Surface.ByPerimeterPoints(points=flatten_5)
lastItem_4 = List.LastItem(list=transpose_2)
reverse_4 = List.Reverse(list=lastItem_4)
list_create_5 = List.Create(item0=lastItem_2, item1=reverse_4)
flatten_6 = List.Flatten(list=list_create_5)
byPerimeterPoints_4 = Surface.ByPerimeterPoints(points=flatten_6)
integer_slider = IntegerSlider(1, range=1..10 step 1)
byControlPoints = NurbsSurface.ByControlPoints(controlVertices=translate, uDegree=integer_slider, vDegree=integer_slider)
list_create_6 = List.Create(item0=byPatch, item1=byPerimeterPoints, item2=byPerimeterPoints_2, item3=byPerimeterPoints_3, item4=byPerimeterPoints_4, item5=byControlPoints)
byJoinedSurfaces = Solid.ByJoinedSurfaces(facesOfSolid=list_create_6)
volume = Solid.Volume(solid=byJoinedSurfaces)
code_block_14 = CodeBlock(rgb=red) { Math.Round(rgb / 10)*10; }
python_script = Python(IN[0]=code_block_14)
# ---------- python_script.python (1 lines) ----------
OUT = [str(int(i)) for i in IN[0]] 
# ----------------------------------------
code_block_15 = CodeBlock(rgb=green) { Math.Round(rgb / 10)*10; }
python_script_2 = Python(IN[0]=code_block_15)  # same code as python_script
code_block_16 = CodeBlock(rgb=blue) { Math.Round(rgb / 10)*10; }
python_script_3 = Python(IN[0]=code_block_16)  # same code as python_script
code_block_17 = CodeBlock(r=python_script, g=python_script_2, b=python_script_3) { r+g+b; }
uniqueItems = List.UniqueItems(list=code_block_17)

# group: дополнительные секущие плоскости
minPoint_2 = BoundingBox.MinPoint(boundingBox=flatten)  # frozen
byOriginNormal = Plane.ByOriginNormal(origin=minPoint_2)
code_block_18 = CodeBlock { 500; }
translate_2 = Geometry.Translate(geometry=byOriginNormal, zTranslation=code_block_18)
list_create_7 = List.Create(item0=translate_2)
split_3 = Geometry.Split(geometry=getItemAtIndex_2, other=translate_2)

# group: !RUN FIRST! SELECT MATERIAL
categories = Categories("OST_Materials")
all_elements_of_category = ElementsOfCategory(Category=categories)
name = Material.Name(material=all_elements_of_category)
all_material_index = Watch(name)
material_index_for_ds = CodeBlock { 246; }
getItemAtIndex_3 = List.GetItemAtIndex(list=all_elements_of_category, index=material_index_for_ds)
name_2 = Material.Name(material=getItemAtIndex_3)

# group: Select Faceы
select_face = DSFaceSelection()  # 1 picked in the model; graph input

# group: IMAGE ON DYNAMO SURFACE
bySurfaceColors = Modifiers.GeometryColor.BySurfaceColors(surface=select_face, colors=pixels)

# group: CREATE POINT CLOUD ON SURFACE
code_block_19 = CodeBlock { 1; }
code_block_20 = CodeBlock(x=code_block_4.out1, y=code_block_4.out2) { x-1; 1/(x-1); y-1; 1/(y-1); }
sequence = Sequence(amount=code_block_20.out2, step=code_block_20.out3)
addItemToEnd = List.AddItemToEnd(item=code_block_19, list=sequence)
sequence_2 = Sequence(amount=code_block_20.out0, step=code_block_20.out1)
addItemToEnd_2 = List.AddItemToEnd(item=code_block_19, list=sequence_2)
pointAtParameter = Surface.PointAtParameter(surface=select_face, u=addItemToEnd, v=addItemToEnd_2, lacing=CrossProduct)

# group: GROUP POINTS BY COLOR
flatten_7 = List.Flatten(list=pointAtParameter)
flatten_8 = List.Flatten(list=pixels)
groupByKey = List.GroupByKey(list=flatten_7, keys=flatten_8)
groupByKey_2 = List.GroupByKey(list=flatten_8, keys=flatten_8)
firstItem_6 = List.FirstItem(list=groupByKey_2.groups@L2)

# group: POINT TO POINT DISTANCE IN CLOUD
firstItem_7 = List.FirstItem(list=pointAtParameter)
firstItem_8 = List.FirstItem(list=firstItem_7)
code_block_21 = CodeBlock { 0; 1; }
getItemAtIndex_4 = List.GetItemAtIndex(list=firstItem_8, index=code_block_21.out0)
getItemAtIndex_5 = List.GetItemAtIndex(list=firstItem_8, index=code_block_21.out1)
distanceTo = Geometry.DistanceTo(geometry=getItemAtIndex_4, other=getItemAtIndex_5)
getItemAtIndex_6 = List.GetItemAtIndex(list=firstItem_7, index=code_block_21.out1)
getItemAtIndex_7 = List.GetItemAtIndex(list=getItemAtIndex_6, index=code_block_21.out0)
distanceTo_2 = Geometry.DistanceTo(geometry=getItemAtIndex_4, other=getItemAtIndex_7)

# group: CREATE CUBOID BY POITNS
byLengths = Cuboid.ByLengths(origin=groupByKey.groups, width=distanceTo, length=distanceTo, height=distanceTo_2)
byUnion = Solid.ByUnion(solids=byLengths)

# group: FLAT SOLIDS - 1 thickness
code_block_22 = CodeBlock(selected_face=select_face) { selected_face; }
thicken = Surface.Thicken(surface=code_block_22)
intersect = Geometry.Intersect(geometry=byUnion, other=thicken, lacing=CrossProduct)
flatten_9 = List.Flatten(list=intersect)

# group: Color cheker
byGeometryColor_4 = Modifiers.GeometryColor.ByGeometryColor(geometry=flatten_9, color=firstItem_6)
color_palette_3 = ColorPalette({R: 238, G: 130, B: 238, A: 255})
byGeometryColor_5 = Modifiers.GeometryColor.ByGeometryColor(geometry=select_face, color=color_palette_3)
color_palette_4 = ColorPalette({R: 0, G: 250, B: 154, A: 255})
byGeometryColor_6 = Modifiers.GeometryColor.ByGeometryColor(geometry=flatten_9, color=color_palette_4)

# group: Select Raster
file_path_2 = Filename("D:\data\BIM\Monro_4colors.png")

# group: Revit Disposier
boolean = BoolSelector(false)
python_script_4 = Python(IN[0]=boolean)
# ---------- python_script_4.python (23 lines) ----------
# Загрузить стандартную библиотеку Python и библиотеку DesignScript
import sys
import clr
import gc
import ctypes
import System
from System.Diagnostics import Process

output = []
if IN[0]:
	output.append(" === Garbage Collector Start === ")
	process_list = ["Revit", "Revit.exe", "Autodesk Revit"]
	clear = ctypes.windll.kernel32.K32EmptyWorkingSet
	all_proceses = [Process.GetProcessesByName(procs) for procs in process_list]
	process_counter = sum([len(procs) for procs in all_proceses])
	output.append(" === Process find: {} === ".format(process_counter))
	clear_proceses_k = [clear(p.Handle) for procs in all_proceses for p in procs]
	clear_proceses_d = [p.Dispose() for procs in all_proceses for p in procs]
	del process_list, clear, all_proceses, clear_proceses_k
	gc.collect()
	output.append(" === Garbage Collector End === ")

OUT = output
# ----------------------------------------

# group: POINT GROUP BY INDEX
integer_slider_2 = IntegerSlider(2, range=1..10 step 1)
getItemAtIndex_8 = List.GetItemAtIndex(list=groupByKey.groups, index=integer_slider_2)

# group: move cuboids to face corner
getItemAtIndex_9 = List.GetItemAtIndex(list=getItemAtIndex_6, index=code_block_21.out1)  # frozen
byTwoPoints = Vector.ByTwoPoints(start=getItemAtIndex_4, end=getItemAtIndex_9)
code_block_23 = CodeBlock { 0.5; }
scale = Vector.Scale(vector=byTwoPoints, scale_factor=code_block_23)
translate_3 = Geometry.Translate(geometry=byUnion, direction=scale)

# group: Select DS Element`ы
select_model_elements = DSModelElementsSelection()  # 1 picked in the model; frozen

# group: Set True to run
change_material = BoolSelector(true)  # graph input
if_2 = Python(IN[0]=change_material, IN[1]=select_model_elements)
# ---------- if_2.python (4 lines) ----------
if IN[0]:
	OUT = IN[1]
else:
	OUT = None
# ----------------------------------------

# group: Set material name
имя_материала = StringInput("ADSK_Жидкость_Вода")  # graph input

count_2 = List.Count(list=select_model_elements)
ofRepeatedItem = List.OfRepeatedItem(item=имя_материала, amount=count_2)

# group: Create new DirectShape by geometry of selected DS and set new material
name_3 = Element.Name(element=if_2)
faces = Element.Faces(element=if_2)
flatten_10 = List.Flatten(list=faces)
категория_для_добавления_ds = Categories("OST_Parts")  # graph input
byName = Material.ByName(name=ofRepeatedItem)
byGeometry = DirectShape.ByGeometry(geometry=flatten_10, category=категория_для_добавления_ds, material=byName, name=ofRepeatedItem)

end = Revit.Transaction.Transaction.End(input=byGeometry)
start = Revit.Transaction.Transaction.Start(input=end)

# group (continued): Create new DirectShape by geometry of selected DS and set new material
flatten_11 = List.Flatten(list=start)
create = List.Create(item0=if_2, item1=flatten_11)

# group: REMOVE SELECT(old) DIRECTSHAPE
code_block_24 = CodeBlock(list=create) { list[0]; }
delete = Element.Delete(element=code_block_24)

# group: CREATE DIRECTSHAPE (and material)
категория_для_добавления_ds_2 = Categories("OST_Parts")  # graph input
RESET = BoolSelector(true)
create_material_by_color_rgb = Python(IN[0]=groupByKey.unique_keys, IN[1]=RESET)
# ---------- create_material_by_color_rgb.python (39 lines) ----------
import sys
import clr
clr.AddReference("RevitServices")
from RevitServices.Persistence import DocumentManager
from RevitServices.Transactions import TransactionManager
clr.AddReference('RevitAPI')
import Autodesk
from Autodesk.Revit.DB import FilteredElementCollector, Material, Color
import System
from System import Byte


def create_or_get_material(current_doc, mat_name, color):
	"""Create material, or find exist, by name."""
	if Material.IsNameUnique(current_doc, mat_name):
		new_mat_id = Material.Create(current_doc, mat_name)
		new_mat = current_doc.GetElement(new_mat_id)
		new_mat.Color = Autodesk.Revit.DB.Color(Byte.Parse(str(color.Red)), Byte.Parse(str(color.Green)), Byte.Parse(str(color.Blue)))
		return new_mat
	else:
		all_materials = FilteredElementCollector(current_doc).OfClass(Material).ToElements()
		for material in all_materials:
			if material.Name == mat_name:
				return material
	return None
	
colors = UnwrapElement(IN[0])

current_doc = DocumentManager.Instance.CurrentDBDocument

materials = []

TransactionManager.Instance.EnsureInTransaction(current_doc)
for color in colors:
	mat = create_or_get_material(current_doc, str(color), color)
	materials.append(mat)
TransactionManager.Instance.ForceCloseTransaction()

OUT = materials
# ----------------------------------------
string_from_object = FromObject(obj=groupByKey.unique_keys)
byGeometry_2 = DirectShape.ByGeometry(geometry=flatten_9, category=категория_для_добавления_ds_2, material=create_material_by_color_rgb, name=string_from_object)

volume_2 = Solid.Volume(solid=flatten_9)

# group: DS area parameter
code_block_25 = CodeBlock { "DS_finishing_area"; }
convert_between_units = DynamoConvert(volume_2, MeasurementType="Area", FromConversion="SquareMillimeter", ToConversion="SquareMeter")
setParameterByName = Element.SetParameterByName(element=byGeometry_2, parameterName=code_block_25, value=convert_between_units)

sum = Math.Sum(values=convert_between_units)
byGeometryColor_7 = Modifiers.GeometryColor.ByGeometryColor(geometry=pointAtParameter@L3, color=pixels)

# group: DS area parameter
code_block_26 = CodeBlock { "DS_finishing_area"; }
area = Surface.Area(surface=flatten_10)
convert_between_units_2 = DynamoConvert(area, MeasurementType="Area", FromConversion="SquareMillimeter", ToConversion="SquareMeter")
setParameterByName_2 = Element.SetParameterByName(element=flatten_11, parameterName=code_block_26, value=convert_between_units_2)

# group: Set True to create DirectShape
создать_ds = BoolSelector(true)  # graph input
if_3 = Python(IN[0]=создать_ds, IN[1]=getItemAtIndex_2)  # same code as if_2

# group: CREATE DIRECTSHAPES
имя_материала_2 = StringInput("ADSK_Бетон_Железобетон")  # graph input
byName_2 = Material.ByName(name=имя_материала_2)
категория_для_добавления_ds_3 = Categories("OST_Parts")  # graph input
code_block_27 = CodeBlock(material=getItemAtIndex_3) { material; }
code_block_28 = CodeBlock(name=name_2) { name; }
byGeometry_3 = DirectShape.ByGeometry(geometry=if_3@L1, category=категория_для_добавления_ds_3, material=code_block_27, name=code_block_28)

# group: DS area parameter
code_block_29 = CodeBlock { "DS_finishing_area"; }
area_2 = Surface.Area(surface=if_3)
convert_between_units_3 = DynamoConvert(area_2, MeasurementType="Area", FromConversion="SquareMillimeter", ToConversion="SquareMeter")
setParameterByName_3 = Element.SetParameterByName(element=byGeometry_3, parameterName=code_block_29, value=convert_between_units_3)
