# Dynamo graph DShapeFinishing.dyn (Dynamo 2.3.0.5885)
# packages: Prorubim Core Kit 2.x 0.5.0

# note: ВСЁ ОСТАЛЬНОЕ

# group: ЭЛЕМЕНТЫ УПРАВЛЕНИЯ
# note: ПЕРЕМЕННЫЕ ЗНАЧЕНИЯ
# note: ЭЛЕМЕНТЫ УПРАВЛЕНИЯ

# group: ПОЛУЧАЕМ ДАННЫЕ
# note: ПОЛУЧАЕМ ДАННЫЕ ИЗ РЕВИТ и других источников

# group: ПРОВЕРОЧНЫЕ НОДЫ
# note: ПРОВЕРОЧНЫЕ НОДЫ

# group: КЛЮЧЕВЫЕ МОМЕНТЫ РАБОТЫ 1
# note: КОНСОЛИДАЦИЯ И СЛОЖНЫЕ ОБРАБОТКИ

# group: ИСПОЛНИТЕЛЬНЫЕ НОДЫ (фильтрование, подбор, списки и т.д.)
# note: ИСПОЛНИТЕЛЬНЫЕ НОДЫ

# group: ПЕРЕДАЁМ ИНФОРМАЦИЮ
# note: ПЕРЕДАЁМ ИНФОРМАЦИЮ В РЕВИТ
# note: ПЕРЕДАЁМ ИНФОРМАЦИЮ ЕЩЁ КУДА-ТО

# group: ЗАПАСНЫЕ ВАРИАНТЫ, ДОПОЛНИТЕЛЬНЫЕ ОПЦИИ
# note: ЗАПАСНЫЕ
# note: ДОПОЛНИТЕЛЬНЫЕ. Градации серово по важности, темнее - важнее

# group: ПРИМЕЧАНИЯ ПО ЦВЕТОВОЙ ГРУППИРОВКЕ
# note: GUIDELINES

# group: КЛЮЧЕВЫЕ МОМЕНТЫ РАБОТЫ 2
# note: УСЛОЖНЕННЫЕ КОНСТРУКЦИИ
# note: УСЛОЖНЕНЫЕ КОНСТРУКЦИИ

# group: Python ноды
# note: Python

# group: ЭЛЕМЕНТЫ УПРАВЛЕНИЯ 2 УРОВЕНЬ
# note: ЭЛЕМЕНТЫ УПРАВЛЕНИЯ
# note: ПЕРЕМЕННЫЕ ЗНАЧЕНИЯ

# group: Запуск питона из внешнего файла
# note: Py - files

categories = Categories("OST_Rooms")  # graph input
all_elements_of_category = ElementsOfCategory(Category=categories)
watch = Watch(all_elements_of_category)
code_block = CodeBlock(t2=watch)
# ---------- code_block.designscript (5 lines) ----------
x = Element.GetParameterValueByName(t2, "Площадь");
bool1 = x > 0;
bool2 = DSCore.Object.IsNull(bool1);
t3 = List.FilterByBoolMask(t2, bool2);
t5 = Dictionary.ValueAtKey(t3, "out");
# ----------------------------------------
code_block_2 = CodeBlock { "Назначение"; }
getParameterValueByName = Element.GetParameterValueByName(element=code_block.t5, parameterName=code_block_2)
code_block_3 = CodeBlock()
# ---------- code_block_3.designscript (3 lines) ----------
["МОП", "Технические помещения", "Кладовые",
	  "Служба эксплуатации", "Служба эксплуатации",
	  "Предприятия общественного питания"];
# ----------------------------------------
equals = List.Equals(objectA=getParameterValueByName@L1, objectB=code_block_3@L1, lacing=CrossProduct)
allFalse = List.AllFalse(list=equals@L2)
filterByBoolMask = List.FilterByBoolMask(list=code_block.t5, mask=allFalse)
параметр_отделки_стен = StringInput("Room_finishing_DS_summ")  # graph input
путь_к_файлу_python = Filename(".\DShapeFinishing.py")  # graph input
forceChildsEval = ForceChildsEval(passObject=путь_к_файлу_python)
find_file_and_import_it = Python(IN[0]=forceChildsEval)
# ---------- find_file_and_import_it.python (11 lines) ----------
import sys
sys.path.append('C:\Program Files (x86)\IronPython 2.7\Lib')
import codecs

try:
	filePath = IN[0]
	with codecs.open(filePath, 'rb', "utf-8") as inf:
		lines = inf.readlines()
	OUT = ''.join(lines)
except:
	OUT = "No file"
# ----------------------------------------
путь_к_файлам_библиотек_python = Directory("C:\git\DirectShapeFinishing")
get_documents = Python()  # unwired: IN[0]
# ---------- get_documents.python (50 lines) ----------
#Copyright(c) 2015, Konrad K Sobon
# @arch_laboratory, http://archi-lab.net

# Huge thanks to Andreas Dieckmann for 
# adding link path functionality

import clr
clr.AddReference('ProtoGeometry')
from Autodesk.DesignScript.Geometry import *

# Import DocumentManager and TransactionManager
clr.AddReference("RevitServices")
import RevitServices
from RevitServices.Persistence import DocumentManager
from RevitServices.Transactions import TransactionManager

from System.Collections.Generic import *

# Import RevitAPI
clr.AddReference("RevitAPI")
import Autodesk
from Autodesk.Revit.DB import *
from Autodesk.Revit.DB.Analysis import *

doc = DocumentManager.Instance.CurrentDBDocument
uiapp = DocumentManager.Instance.CurrentUIApplication
app = uiapp.Application

# Import ToDSType(bool) extension method
clr.AddReference("RevitNodes")
import Revit
clr.ImportExtensions(Revit.Elements)

#The inputs to this node will be stored as a list in the IN variable.
dataEnteringNode = IN

collector = Autodesk.Revit.DB.FilteredElementCollector(doc)
linkInstances = collector.OfClass(Autodesk.Revit.DB.RevitLinkInstance)

linkDoc, linkName, linkPath = [], [], []
for i in linkInstances:
	linkDoc.append(i.GetLinkDocument())
	linkName.append(i.Name)
	try:
		linkPath.append(i.GetLinkDocument().PathName)
	except:
		linkPath.append(None)
		pass

OUT = linkDoc, linkName, linkInstances, linkPath
# ----------------------------------------
watch_2 = Watch(get_documents)
слова_в_типах_стен_чтобы = CodeBlock { ["ADSK_Перегородка_ГКЛО_125", "ADSK_Перегородка_ПГП_100"]; }  # "Слова в типах стен чтобы исключить"
слова_в_типах_стен_чтобы_2 = CodeBlock { ["Бетон"]; }  # "Слова в типах стен чтобы исключить"
python_script_from_string = PythonStringNode(script=find_file_and_import_it, IN[0]=путь_к_файлам_библиотек_python, IN[1]=filterByBoolMask.out, IN[2]=watch_2, IN[3]=слова_в_типах_стен_чтобы, IN[4]=слова_в_типах_стен_чтобы_2)  # frozen
code_block_4 = CodeBlock(time=python_script_from_string, surface=python_script_from_string, mat_type_name=python_script_from_string) { time[0]; surface[2]; mat_type_name[3]; }
area = Surface.Area(surface=code_block_4.out1)
convert_between_units = DynamoConvert(area, MeasurementType="Area", FromConversion="SquareMillimeter", ToConversion="SquareMeter")
sum = Math.Sum(values=convert_between_units@L2)
code_block_5 = CodeBlock { 2; }
round = Math.Round(number=sum, digits=code_block_5)
setParameterByName = Element.SetParameterByName(element=filterByBoolMask.out, parameterName=параметр_отделки_стен, value=round)
TIME = Watch(code_block_4.out0)
запуск_построения_геометрии = BoolSelector(true)  # graph input
code_block_6 = CodeBlock { null; }
if_ = Python(IN[0]=запуск_построения_геометрии, IN[1]=code_block_4.out1, IN[2]=code_block_6)  # frozen
# ---------- if_.python (12 lines) ----------
import clr
boolean = IN[0]
true = UnwrapElement(IN[1])
false = UnwrapElement(IN[2])

if boolean:
	out = true
else:
	out = false

#Назначьте вывод переменной OUT.
OUT = out
# ----------------------------------------
categories_2 = Categories("OST_Walls")  # graph input
byName = Material.ByName(name=code_block_4.out2)
code_block_7 = CodeBlock(name=code_block_4.out2) { name; }
byGeometry = DirectShape.ByGeometry(geometry=if_, category=categories_2, material=byName, name=code_block_7)
параметр_отделки_элемента = StringInput("DS_finishing_area")  # graph input
setParameterByName_2 = Element.SetParameterByName(element=byGeometry, parameterName=параметр_отделки_элемента, value=convert_between_units)
параметр_отделки_элемента_2 = StringInput("ADSK_Номер квартиры")  # graph input
getParameterValueByName_2 = Element.GetParameterValueByName(element=filterByBoolMask.out, parameterName=параметр_отделки_элемента_2)
setParameterByName_3 = Element.SetParameterByName(element=setParameterByName_2, parameterName=параметр_отделки_элемента_2, value=getParameterValueByName_2)
параметр_этажа = StringInput("ADSK_Этаж")  # graph input
параметр_уровня = StringInput("Уровень")  # graph input
getParameterValueByName_3 = Element.GetParameterValueByName(element=filterByBoolMask.out, parameterName=параметр_уровня)
setParameterByName_4 = Element.SetParameterByName(element=setParameterByName_3, parameterName=параметр_этажа, value=getParameterValueByName_3)
параметр_этажа_2 = StringInput("Комментарии")  # graph input
setParameterByName_5 = Element.SetParameterByName(element=setParameterByName_4, parameterName=параметр_этажа_2, value=code_block_7)
watch_3 = Watch(code_block_4.out1)
watch_4 = Watch(code_block_4.out2)
