# Dynamo graph DirectShapeDirectShapeFinishing.dyn (Dynamo 2.3.0.5885)

# group: ЭЛЕМЕНТЫ УПРАВЛЕНИЯ
# note: ПЕРЕМЕННЫЕ ЗНАЧЕНИЯ
# note: ЭЛЕМЕНТЫ УПРАВЛЕНИЯ

# group: ПОЛУЧАЕМ ДАННЫЕ
# note: ПОЛУЧАЕМ ДАННЫЕ ИЗ РЕВИТ и других источников

# group: ПРОВЕРОЧНЫЕ НОДЫ
# note: ПРОВЕРОЧНЫЕ НОДЫ

# group: КЛЮЧЕВЫЕ МОМЕНТЫ РАБОТЫ 1
# note: КОНСОЛИДАЦИЯ И СЛОЖНЫЕ ОБРАБОТКИ

# group: ИСПОЛНИТЕЛЬНЫЕ НОДЫ (фильтрование, подбор, списки и т.д.)
# note: ИСПОЛНИТЕЛЬНЫЕ НОДЫ

# group: ПЕРЕДАЁМ ИНФОРМАЦИЮ
# note: ПЕРЕДАЁМ ИНФОРМАЦИЮ В РЕВИТ
# note: ПЕРЕДАЁМ ИНФОРМАЦИЮ ЕЩЁ КУДА-ТО

# group: ЗАПАСНЫЕ ВАРИАНТЫ, ДОПОЛНИТЕЛЬНЫЕ ОПЦИИ
# note: ЗАПАСНЫЕ
# note: ДОПОЛНИТЕЛЬНЫЕ. Градации серово по важности, темнее - важнее

# group: ПРИМЕЧАНИЯ ПО ЦВЕТОВОЙ ГРУППИРОВКЕ
# note: GUIDELINES

# group: КЛЮЧЕВЫЕ МОМЕНТЫ РАБОТЫ 2
# note: УСЛОЖНЕННЫЕ КОНСТРУКЦИИ
# note: УСЛОЖНЕНЫЕ КОНСТРУКЦИИ

# group: Python ноды
# note: Python

# group: ЭЛЕМЕНТЫ УПРАВЛЕНИЯ 2 УРОВЕНЬ
# note: ЭЛЕМЕНТЫ УПРАВЛЕНИЯ
# note: ПЕРЕМЕННЫЕ ЗНАЧЕНИЯ

# group: Запуск питона из внешнего файла
# note: Py - files

string = StringInput("МОП")  # graph input
categories = Categories("OST_Rooms")  # graph input
all_elements_of_category = ElementsOfCategory(Category=categories)
string_2 = StringInput("ADSK_Индекс помещения")  # graph input
getParameterValueByName = Element.GetParameterValueByName(element=all_elements_of_category, parameterName=string_2)
length = String.Length(str=getParameterValueByName)
code_block = CodeBlock { 0; }
gt = length > code_block
filterByBoolMask = List.FilterByBoolMask(list=all_elements_of_category, mask=gt)
code_block_2 = CodeBlock(rom=filterByBoolMask.in) { rom; }
string_3 = StringInput("Уровень")  # graph input
getParameterValueByName_2 = Element.GetParameterValueByName(element=code_block_2, parameterName=string_3)
string_from_object = FromObject(obj=getParameterValueByName_2)
номер_функции = StringInput("Этаж 04")  # graph input
equals = List.Equals(objectA=string_from_object, objectB=номер_функции)
filterByBoolMask_2 = List.FilterByBoolMask(list=code_block_2, mask=equals)
номер_функции_2 = StringInput("План подземного паркинга (Для отделки)")  # graph input

# group: Get Revit Selection:
pys_get_revit_selection = Python()  # unwired: IN[0]
# ---------- pys_get_revit_selection.python (22 lines) ----------
import clr
clr.AddReference('RevitServices')
clr.AddReference('RevitAPI')
from Autodesk.Revit.DB import *
import RevitServices
from RevitServices.Persistence import DocumentManager
from Autodesk.Revit.ApplicationServices import Application

reset = IN[0]

doc = DocumentManager.Instance.CurrentDBDocument
uidoc = DocumentManager.Instance.CurrentUIApplication.ActiveUIDocument
ids = uidoc.Selection.GetElementIds()

idd = [str(i) for i in ids]

if isinstance(idd, list) == True:
	elems = [doc.GetElement(ElementId(int(i))) for i in idd]
else:
	elems = doc.GetElement(ElementId(int(idd)))

OUT = elems
# ----------------------------------------

type = Object.Type(obj=pys_get_revit_selection)
code_block_3 = CodeBlock(type_string=type) { type_string == "Revit.Elements.Room"; }
filterByBoolMask_3 = List.FilterByBoolMask(list=pys_get_revit_selection, mask=code_block_3)
watch = Watch(filterByBoolMask_3.in)
string_4 = StringInput("Area")  # graph input
getParameterValueByName_3 = Element.GetParameterValueByName(element=watch, parameterName=string_4)
string_from_object_2 = FromObject(obj=getParameterValueByName_3)
length_2 = String.Length(str=string_from_object_2)
code_block_4 = CodeBlock { 0; }
gt_2 = length_2 > code_block_4
filterByBoolMask_4 = List.FilterByBoolMask(list=watch, mask=gt_2)
flatten = List.Flatten(list=filterByBoolMask_4.in)
параметр_отделки_стен = StringInput("АБН_Отделка стен общая")  # graph input
get_documents = Python()  # unwired: IN[0]
# ---------- get_documents.python (50 lines) ----------
#Copyright(c) 2015, Konrad K Sobon
# @arch_laboratory, http://archi-lab.net

# Huge thanks to Andreas Dieckmann for 
# adding link path functionality

import clr
clr.AddReference('ProtoGeometry')
from Autodesk.DesignScript.Geometry import *

# Import DocumentManager and TransactionManager
clr.AddReference("RevitServices")
import RevitServices
from RevitServices.Persistence import DocumentManager
from RevitServices.Transactions import TransactionManager

from System.Collections.Generic import *

# Import RevitAPI
clr.AddReference("RevitAPI")
import Autodesk
from Autodesk.Revit.DB import *
from Autodesk.Revit.DB.Analysis import *

doc = DocumentManager.Instance.CurrentDBDocument
uiapp = DocumentManager.Instance.CurrentUIApplication
app = uiapp.Application

# Import ToDSType(bool) extension method
clr.AddReference("RevitNodes")
import Revit
clr.ImportExtensions(Revit.Elements)

#The inputs to this node will be stored as a list in the IN variable.
dataEnteringNode = IN

collector = Autodesk.Revit.DB.FilteredElementCollector(doc)
linkInstances = collector.OfClass(Autodesk.Revit.DB.RevitLinkInstance)

linkDoc, linkName, linkPath = [], [], []
for i in linkInstances:
	linkDoc.append(i.GetLinkDocument())
	linkName.append(i.Name)
	try:
		linkPath.append(i.GetLinkDocument().PathName)
	except:
		linkPath.append(None)
		pass

OUT = linkDoc, linkName, linkInstances, linkPath
# ----------------------------------------
выбрать_индекс_связанного_файла = CodeBlock(l=get_documents) { l[0][0]; }
а_высота_по_помещениям_б_высота = BoolSelector(true)  # "А) Высота по помещениям Б) Высота задана"; graph input
code_block_5 = CodeBlock { 3350.0; }
смещение_по_z = BoolSelector(false)  # graph input
code_block_6 = CodeBlock { -1000; }

# group: Элементы окруужающие помещение
find_file_and_import_it = Python()  # unwired: IN[0]
# ---------- find_file_and_import_it.python (11 lines) ----------
import sys
sys.path.append('C:\Program Files (x86)\IronPython 2.7\Lib')
import codecs

try:
	filePath = IN[0]
	with codecs.open(filePath, 'rb', "utf-8") as inf:
		lines = inf.readlines()
	OUT = ''.join(lines)
except:
	OUT = "No file"
# ----------------------------------------
python_script_from_string = PythonStringNode(script=find_file_and_import_it, IN[0]=flatten, IN[1]=выбрать_индекс_связанного_файла, IN[2]=а_высота_по_помещениям_б_высота, IN[3]=code_block_5, IN[4]=смещение_по_z, IN[5]=code_block_6)
code_block_7 = CodeBlock(surface=python_script_from_string, mat_type_name=python_script_from_string, level=python_script_from_string) { surface[0]; mat_type_name[1]; level[2]; }
путь_к_файлу_python = Filename(".\N.Отделка помещений__SpatialElementGeometryCalculator.py")  # graph input

area = Surface.Area(surface=code_block_7.out0)
sum = Math.Sum(values=area@L2)
convert_between_units = DynamoConvert(sum, MeasurementType="Area", FromConversion="SquareMillimeter", ToConversion="SquareMeter")
setParameterByName = Element.SetParameterByName(element=flatten, parameterName=параметр_отделки_стен, value=convert_between_units)
boolean = BoolSelector(true)  # frozen
code_block_8 = CodeBlock { 1; 2; }
if_ = Python(IN[0]=boolean, IN[1]=code_block_8.out0, IN[2]=code_block_8.out1)
# ---------- if_.python (12 lines) ----------
import clr
boolean = IN[0]
true = UnwrapElement(IN[1])
false = UnwrapElement(IN[2])

if boolean:
	out = true
else:
	out = false

#Назначьте вывод переменной OUT.
OUT = out
# ----------------------------------------
parameters = Element.Parameters()  # unwired: element
geometry = Element.Geometry()  # unwired: element
setParameterByName_2 = Element.SetParameterByName()  # unwired: element, parameterName, value
# note: ВСЁ ОСТАЛЬНОЕ
getParameterValueByName_4 = Element.GetParameterValueByName()  # unwired: element, parameterName

# group: Parameters name from language
parameters_name_from_language = Python()  # graph input; frozen
# ---------- parameters_name_from_language.python (18 lines) ----------
import clr
clr.AddReference('RevitServices')
import RevitServices
from RevitServices.Persistence import DocumentManager

uiapp = DocumentManager.Instance.CurrentUIApplication
app = uiapp.Application
lng = app.Language
rus = ["Тип","Имя семейства","Имя типа"]
enu = ["Type","Family name","Type name"]
out = []
if str(lng) == "Russian":
	out = rus
else:
	out = enu
#English_USA
#Russian
OUT = out
# ----------------------------------------

# group: элементы внутри групп
members = Python()  # "Group.Members"; frozen; unwired: IN[0]
# ---------- members.python (19 lines) ----------
import clr
clr.AddReference('RevitAPI')
from Autodesk.Revit.DB import *

clr.AddReference("RevitNodes")
import Revit
clr.ImportExtensions(Revit.Elements)

groups = UnwrapElement(IN[0])
elementlist = list()
for item in groups:
	try:
		memberlist = list()
		for member in item.GetMemberIds():
			memberlist.append(item.Document.GetElement(member))
		elementlist.append(memberlist)
	except:
		elementlist.append(list())
OUT = elementlist
# ----------------------------------------

путь_к_файлу_python_2 = Filename(".\N.Отделка помещений_сбор элементов вокруг_1.7.py")  # frozen
не_читает_кирилицу = Python(IN[0]=путь_к_файлу_python_2)  # unwired: IN[1]
# ---------- не_читает_кирилицу.python (9 lines) ----------
try:
	filePath = IN[0]

	with open(filePath, 'rb') as inf:
	    lines = inf.readlines()

	OUT = ''.join(lines)
except Exception, e:
	OUT = "No file"
# ----------------------------------------
python_script_from_string_2 = PythonStringNode(script=не_читает_кирилицу)  # unwired: IN[0]
categories_2 = Categories()  # nothing selected; frozen
all_elements_of_category_2 = ElementsOfCategory(Category=categories_2)
regenerate = Python()  # frozen; unwired: IN[0]
# ---------- regenerate.python (26 lines) ----------
import clr

# Import DocumentManager and TransactionManager
clr.AddReference("RevitServices")
import RevitServices
from RevitServices.Persistence import DocumentManager


# Import RevitAPI
clr.AddReference("RevitAPI")
import Autodesk
from Autodesk.Revit.DB import *

doc = DocumentManager.Instance.CurrentDBDocument


#The inputs to this node will be stored as a list in the IN variable.
list = IN[0]


if list:
	doc.Regenerate()
	out = "Regeneration complete"
else:
	out = "fail"
OUT = out
# ----------------------------------------
shablon_python_shablon = Python()  # frozen; unwired: IN[0]
# ---------- shablon_python_shablon.python (81 lines) ----------
# -*- coding: utf-8 -*- 
#-----------------------Импоорт библиотек----------------------
import sys
sys.path.append('C:\Program Files (x86)\IronPython 2.7\Lib')

import clr
clr.AddReference('RevitAPI')
import Autodesk
from Autodesk.Revit.DB import *

clr.AddReference("RevitNodes") 
import Revit
from Revit.Elements import *

clr.ImportExtensions(Revit.Elements) #ToDSType не работает без
clr.ImportExtensions(Revit.GeometryConversion)

clr.AddReference("RevitServices")
import RevitServices
from RevitServices.Persistence import DocumentManager
from RevitServices.Transactions import TransactionManager

clr.AddReference('ProtoGeometry')
from Autodesk.DesignScript.Geometry import *

clr.AddReference('System')
from System.Collections.Generic import List

#-----------------------ИМПОРТ БИБЛИОТЕК----------------------
"""-"""
#-----------------------ФУНКЦИИ----------------------

def __x__(x):
	x="x"
	return x
	
#-----------------------ФУНКЦИИ----------------------
"""-"""
#-----------------------АПИ ПАРАМЕТРЫ----------------------

doc = DocumentManager.Instance.CurrentDBDocument
#link_doc = UnwrapElement(IN[1])
#uiapp = DocumentManager.Instance.CurrentUIApplication
#app = uiapp.Application
#version = app.VersionNumber
#options = Autodesk.Revit.DB.SpatialElementBoundaryOptions()
#options.StoreFreeBoundaryFaces = True --------- ЗАПИСЬ В PROPERTIS !!!!!!!!!!!!!!!
#options.SpatialElementBoundaryLocation = SpatialElementBoundaryLocation.Center --------- ЗАПИСЬ В Enumeration !!!!!!!!!!!!!!!
calculator = SpatialElementGeometryCalculator(doc)

g_id_list = []

bxList = List[ElementId](g_id_list)

#-----------------------АПИ ПАРАМЕТРЫ----------------------
"""-"""
#-----------------------РАБОЧИЕ ПАРАМЕТРЫ----------------------

rooms = UnwrapElement(IN[0])

#-----------------------РАБОЧИЕ ПАРАМЕТРЫ----------------------	
"""-"""
#-----------------------ТЕСТОВЫЕ ПАРАМЕТРЫ----------------------

test = []

#-----------------------ТЕСТОВЫЕ ПАРАМЕТРЫ----------------------
"""-"""
#-----------------------НАЧАЛО СКРИПТА----------------------

x = 0
if rooms == None:
	rooms = [0,0]

for room in rooms:
	x=__x__(x)+__x__(x)
#TransactionManager.Instance.EnsureInTransaction(doc)
#TransactionManager.Instance.TransactionTaskDone()
#-----------------------КОНЕЦ СКРИПТА----------------------

OUT = x
# ----------------------------------------
members_2 = Python()  # "Object.Members"; frozen; unwired: IN[0]
# ---------- members_2.python (14 lines) ----------
import clr

items = IN[0]
elementlist = list()

try:
	clr.AddReference('RevitAPI')
	from Autodesk.Revit.DB import *
	for item in items:
		elementlist.append(dir(UnwrapElement(item)))
except:
	for item in items:
		elementlist.append(dir(item))
OUT = elementlist
# ----------------------------------------
filteredElementCollector = Python()  # frozen; unwired: IN[0]
# ---------- filteredElementCollector.python (29 lines) ----------
if IN[1]:
	import clr
	
	# Import DocumentManager and TransactionManager
	clr.AddReference("RevitServices")
	import RevitServices
	from RevitServices.Persistence import DocumentManager
	
	
	# Import RevitAPI
	clr.AddReference("RevitAPI")
	import Autodesk
	from Autodesk.Revit.DB import *
	
	doc = DocumentManager.Instance.CurrentDBDocument
	uiapp = DocumentManager.Instance.CurrentUIApplication
	app = uiapp.Application
	
	from System.Collections.Generic import *
	
	
	#The inputs to this node will be stored as a list in the IN variable.
	dataEnteringNode = IN
	collector = FilteredElementCollector(doc)
	elements = collector.OfCategory(BuiltInCategory.OST_Views).ToElements()
	
	OUT = sheetInstances
else:
	OUT = "скрипт не выполнен"
# ----------------------------------------
путь_к_файлу_python_3 = Filename(".\N.Отделка помещений___SpElGeoCalc_высота по помещениям.py")  # graph input
code_block_9 = CodeBlock { "Имя"; "ADSK_Индекс помещения"; "Номер"; "ROM_Номер"; }
getParameterValueByName_5 = Element.GetParameterValueByName(element=flatten, parameterName=code_block_9.out3)
getParameterValueByName_6 = Element.GetParameterValueByName(element=flatten, parameterName=code_block_9.out0)
getParameterValueByName_7 = Element.GetParameterValueByName(element=flatten, parameterName=code_block_9.out2)
code_block_10 = CodeBlock(func=getParameterValueByName_5, nomer_func=getParameterValueByName_6, imja=getParameterValueByName_7) { func+" ("+nomer_func+")"+" - "+imja; }
путь_к_файлу_python_4 = Filename("..\..\Z.Тест\N.Отделка помещений___SpElGeoCalc___GetBoundarySegments___Material type.py")  # graph input
параметр_отделки_стен_2 = StringInput("АБН_Площадь проёмов")  # graph input
запуск_построения_геометрии = BoolSelector(true)  # graph input
code_block_11 = CodeBlock { null; }
if_2 = Python(IN[0]=запуск_построения_геометрии, IN[1]=code_block_7.out0, IN[2]=code_block_11)  # same code as if_
categories_3 = Categories("OST_Parts")  # graph input
byName = Material.ByName(name=code_block_7.out1)
getParameterValueByName_8 = Element.GetParameterValueByName(element=flatten, parameterName=code_block_9.out1)
code_block_12 = CodeBlock(name=getParameterValueByName_8) { name; }
byGeometry = DirectShape.ByGeometry(geometry=if_2, category=categories_3, material=byName, name=code_block_12)
параметр_отделки_элемента = StringInput("АБН_Площадь отделки (элементы)")  # graph input
convert_between_units_2 = DynamoConvert(area, MeasurementType="Area", FromConversion="SquareMillimeter", ToConversion="SquareMeter")
setParameterByName_3 = Element.SetParameterByName(element=byGeometry, parameterName=параметр_отделки_элемента, value=convert_between_units_2)
параметр_отделки_элемента_2 = StringInput("АБН_Уровень")  # graph input
name = Level.Name(level=code_block_7.out2)
setParameterByName_4 = Element.SetParameterByName(element=setParameterByName_3, parameterName=параметр_отделки_элемента_2, value=name)
string_5 = StringInput("Служба эксплуатации")  # graph input
string_6 = StringInput("Технические помещения")  # graph input
code_block_13 = CodeBlock { ["Автостоянка","МХМТС"]; }
code_block_14 = CodeBlock { ["Помещения"]; }
equals_2 = List.Equals(objectA=getParameterValueByName, objectB=code_block_14@L1)
transpose = List.Transpose(lists=equals_2)
allFalse = List.AllFalse(list=transpose@L2)
code_block_15 = CodeBlock { ["Коридор"]; }
code_block_16 = CodeBlock { ["Лифтовый холл"]; }
code_block_17 = CodeBlock(x=python_script_from_string) { x[4]; }
flatten_2 = List.Flatten(list=code_block_17)
uniqueItems = List.UniqueItems(list=flatten_2)
minimumItem = List.MinimumItem(list=uniqueItems)
параметр_отделки_элемента_3 = StringInput("ADSK_Номер квартиры")  # graph input
setParameterByName_5 = Element.SetParameterByName(element=setParameterByName_3, parameterName=параметр_отделки_элемента_3, value=code_block_12)
minimumItem_2 = List.MinimumItem(list=area)
convert_between_units_3 = DynamoConvert(minimumItem_2, MeasurementType="Area", FromConversion="SquareMillimeter", ToConversion="SquareMeter")
