# Dynamo graph DirectShapeFinishing.dyn (Dynamo 2.3.0.5885)
# packages: archi-lab.net 2022.210.1821, Prorubim Core Kit 2.x 0.5.0

# group: ЭЛЕМЕНТЫ УПРАВЛЕНИЯ
# note: ПЕРЕМЕННЫЕ ЗНАЧЕНИЯ
# note: ЭЛЕМЕНТЫ УПРАВЛЕНИЯ

# group: ПОЛУЧАЕМ ДАННЫЕ
# note: ПОЛУЧАЕМ ДАННЫЕ ИЗ РЕВИТ и других источников

# group: ПРОВЕРОЧНЫЕ НОДЫ
# note: ПРОВЕРОЧНЫЕ НОДЫ

# group: КЛЮЧЕВЫЕ МОМЕНТЫ РАБОТЫ 1
# note: КОНСОЛИДАЦИЯ И СЛОЖНЫЕ ОБРАБОТКИ

# group: ИСПОЛНИТЕЛЬНЫЕ НОДЫ (фильтрование, подбор, списки и т.д.)
# note: ИСПОЛНИТЕЛЬНЫЕ НОДЫ

# group: ПЕРЕДАЁМ ИНФОРМАЦИЮ
# note: ПЕРЕДАЁМ ИНФОРМАЦИЮ В РЕВИТ
# note: ПЕРЕДАЁМ ИНФОРМАЦИЮ ЕЩЁ КУДА-ТО

# group: ЗАПАСНЫЕ ВАРИАНТЫ, ДОПОЛНИТЕЛЬНЫЕ ОПЦИИ
# note: ЗАПАСНЫЕ
# note: ДОПОЛНИТЕЛЬНЫЕ. Градации серово по важности, темнее - важнее

# group: ПРИМЕЧАНИЯ ПО ЦВЕТОВОЙ ГРУППИРОВКЕ
# note: GUIDELINES

# group: КЛЮЧЕВЫЕ МОМЕНТЫ РАБОТЫ 2
# note: УСЛОЖНЕННЫЕ КОНСТРУКЦИИ
# note: УСЛОЖНЕНЫЕ КОНСТРУКЦИИ

# group: Python ноды
# note: Python

# group: ЭЛЕМЕНТЫ УПРАВЛЕНИЯ 2 УРОВЕНЬ
# note: ЭЛЕМЕНТЫ УПРАВЛЕНИЯ
# note: ПЕРЕМЕННЫЕ ЗНАЧЕНИЯ

# group: Запуск питона из внешнего файла
# note: Py - files

categories = Categories("OST_Rooms")  # graph input
all_elements_of_category = ElementsOfCategory(Category=categories)

# group: rooms
watch = Watch(all_elements_of_category)

параметр_отделки_стен = StringInput("Room_finishing_DS_summ")  # graph input
путь_к_файлу_python = Filename(".\DirectShapeFinishing.py")  # graph input
forceChildsEval = ForceChildsEval(passObject=путь_к_файлу_python)
get_documents = Python()  # unwired: IN[0]
# ---------- get_documents.python (50 lines) ----------
#Copyright(c) 2015, Konrad K Sobon
# @arch_laboratory, http://archi-lab.net

# Huge thanks to Andreas Dieckmann for 
# adding link path functionality

import clr
clr.AddReference('ProtoGeometry')
from Autodesk.DesignScript.Geometry import *

# Import DocumentManager and TransactionManager
clr.AddReference("RevitServices")
import RevitServices
from RevitServices.Persistence import DocumentManager
from RevitServices.Transactions import TransactionManager

from System.Collections.Generic import *

# Import RevitAPI
clr.AddReference("RevitAPI")
import Autodesk
from Autodesk.Revit.DB import *
from Autodesk.Revit.DB.Analysis import *

doc = DocumentManager.Instance.CurrentDBDocument
uiapp = DocumentManager.Instance.CurrentUIApplication
app = uiapp.Application

# Import ToDSType(bool) extension method
clr.AddReference("RevitNodes")
import Revit
clr.ImportExtensions(Revit.Elements)

#The inputs to this node will be stored as a list in the IN variable.
dataEnteringNode = IN

collector = Autodesk.Revit.DB.FilteredElementCollector(doc)
linkInstances = collector.OfClass(Autodesk.Revit.DB.RevitLinkInstance)

linkDoc, linkName, linkPath = [], [], []
for i in linkInstances:
	linkDoc.append(i.GetLinkDocument())
	linkName.append(i.Name)
	try:
		linkPath.append(i.GetLinkDocument().PathName)
	except:
		linkPath.append(None)
		pass

OUT = linkDoc, linkName, linkInstances, linkPath
# ----------------------------------------
watch_2 = Watch(get_documents)
а_высота_по_помещениям_б_высота = BoolSelector(true)  # "А) Высота по помещениям Б) Высота задана"; graph input
code_block = CodeBlock { 3350.0; }
смещение_по_z = BoolSelector(false)  # graph input
code_block_2 = CodeBlock { -1000; }
code_block_3 = CodeBlock { ["aa", "bb", "1234ab"]; }

# group: Элементы окруужающие помещение
find_file_and_import_it = Python(IN[0]=forceChildsEval)
# ---------- find_file_and_import_it.python (11 lines) ----------
import sys
sys.path.append('C:\Program Files (x86)\IronPython 2.7\Lib')
import codecs

try:
	filePath = IN[0]
	with codecs.open(filePath, 'rb', "utf-8") as inf:
		lines = inf.readlines()
	OUT = ''.join(lines)
except:
	OUT = "No file"
# ----------------------------------------
python_script_from_string = PythonStringNode(script=find_file_and_import_it, IN[0]=watch, IN[1]=watch_2, IN[2]=а_высота_по_помещениям_б_высота, IN[3]=code_block, IN[4]=смещение_по_z, IN[5]=code_block_2, IN[6]=code_block_3)  # unwired: IN[7]
code_block_4 = CodeBlock(time=python_script_from_string, surface=python_script_from_string, mat_type_name=python_script_from_string) { time[0]; surface[1]; mat_type_name[2]; }

area = Surface.Area(surface=code_block_4.out1)
convert_between_units = DynamoConvert(area, MeasurementType="Area", FromConversion="SquareMillimeter", ToConversion="SquareMeter")
sum = Math.Sum(values=convert_between_units@L2)
code_block_5 = CodeBlock { 2; }
round = Math.Round(number=sum, digits=code_block_5)
setParameterByName = Element.SetParameterByName(element=watch, parameterName=параметр_отделки_стен, value=round)
выбрать_индекс_связанного_файла = CodeBlock(link_doc=get_documents, inst=get_documents) { link_doc[0][0]; inst[2][0]; }
boolean = BoolSelector(true)  # frozen
code_block_6 = CodeBlock { 1; 2; }
if_ = Python(IN[0]=boolean, IN[1]=code_block_6.out0, IN[2]=code_block_6.out1)
# ---------- if_.python (12 lines) ----------
import clr
boolean = IN[0]
true = UnwrapElement(IN[1])
false = UnwrapElement(IN[2])

if boolean:
	out = true
else:
	out = false

#Назначьте вывод переменной OUT.
OUT = out
# ----------------------------------------
parameters = Element.Parameters()  # unwired: element
geometry = Element.Geometry()  # unwired: element
setParameterByName_2 = Element.SetParameterByName()  # unwired: element, parameterName, value
# note: ВСЁ ОСТАЛЬНОЕ
getParameterValueByName = Element.GetParameterValueByName()  # unwired: element, parameterName

# group: Parameters name from language
parameters_name_from_language = Python()  # graph input; frozen
# ---------- parameters_name_from_language.python (18 lines) ----------
import clr
clr.AddReference('RevitServices')
import RevitServices
from RevitServices.Persistence import DocumentManager

uiapp = DocumentManager.Instance.CurrentUIApplication
app = uiapp.Application
lng = app.Language
rus = ["Тип","Имя семейства","Имя типа"]
enu = ["Type","Family name","Type name"]
out = []
if str(lng) == "Russian":
	out = rus
else:
	out = enu
#English_USA
#Russian
OUT = out
# ----------------------------------------

# group: элементы внутри групп
members = Python()  # "Group.Members"; frozen; unwired: IN[0]
# ---------- members.python (19 lines) ----------
import clr
clr.AddReference('RevitAPI')
from Autodesk.Revit.DB import *

clr.AddReference("RevitNodes")
import Revit
clr.ImportExtensions(Revit.Elements)

groups = UnwrapElement(IN[0])
elementlist = list()
for item in groups:
	try:
		memberlist = list()
		for member in item.GetMemberIds():
			memberlist.append(item.Document.GetElement(member))
		elementlist.append(memberlist)
	except:
		elementlist.append(list())
OUT = elementlist
# ----------------------------------------

путь_к_файлу_python_2 = Filename(".\N.Отделка помещений_сбор элементов вокруг_1.7.py")  # frozen
не_читает_кирилицу = Python(IN[0]=путь_к_файлу_python_2)  # unwired: IN[1]
# ---------- не_читает_кирилицу.python (9 lines) ----------
try:
	filePath = IN[0]

	with open(filePath, 'rb') as inf:
	    lines = inf.readlines()

	OUT = ''.join(lines)
except Exception, e:
	OUT = "No file"
# ----------------------------------------
python_script_from_string_2 = PythonStringNode(script=не_читает_кирилицу)  # unwired: IN[0]
categories_2 = Categories()  # nothing selected; frozen
all_elements_of_category_2 = ElementsOfCategory(Category=categories_2)
regenerate = Python()  # frozen; unwired: IN[0]
# ---------- regenerate.python (26 lines) ----------
import clr

# Import DocumentManager and TransactionManager
clr.AddReference("RevitServices")
import RevitServices
from RevitServices.Persistence import DocumentManager


# Import RevitAPI
clr.AddReference("RevitAPI")
import Autodesk
from Autodesk.Revit.DB import *

doc = DocumentManager.Instance.CurrentDBDocument


#The inputs to this node will be stored as a list in the IN variable.
list = IN[0]


if list:
	doc.Regenerate()
	out = "Regeneration complete"
else:
	out = "fail"
OUT = out
# ----------------------------------------
shablon_python_shablon = Python()  # frozen; unwired: IN[0]
# ---------- shablon_python_shablon.python (81 lines) ----------
# -*- coding: utf-8 -*- 
#-----------------------Импоорт библиотек----------------------
import sys
sys.path.append('C:\Program Files (x86)\IronPython 2.7\Lib')

import clr
clr.AddReference('RevitAPI')
import Autodesk
from Autodesk.Revit.DB import *

clr.AddReference("RevitNodes") 
import Revit
from Revit.Elements import *

clr.ImportExtensions(Revit.Elements) #ToDSType не работает без
clr.ImportExtensions(Revit.GeometryConversion)

clr.AddReference("RevitServices")
import RevitServices
from RevitServices.Persistence import DocumentManager
from RevitServices.Transactions import TransactionManager

clr.AddReference('ProtoGeometry')
from Autodesk.DesignScript.Geometry import *

clr.AddReference('System')
from System.Collections.Generic import List

#-----------------------ИМПОРТ БИБЛИОТЕК----------------------
"""-"""
#-----------------------ФУНКЦИИ----------------------

def __x__(x):
	x="x"
	return x
	
#-----------------------ФУНКЦИИ----------------------
"""-"""
#-----------------------АПИ ПАРАМЕТРЫ----------------------

doc = DocumentManager.Instance.CurrentDBDocument
#link_doc = UnwrapElement(IN[1])
#uiapp = DocumentManager.Instance.CurrentUIApplication
#app = uiapp.Application
#version = app.VersionNumber
#options = Autodesk.Revit.DB.SpatialElementBoundaryOptions()
#options.StoreFreeBoundaryFaces = True --------- ЗАПИСЬ В PROPERTIS !!!!!!!!!!!!!!!
#options.SpatialElementBoundaryLocation = SpatialElementBoundaryLocation.Center --------- ЗАПИСЬ В Enumeration !!!!!!!!!!!!!!!
calculator = SpatialElementGeometryCalculator(doc)

g_id_list = []

bxList = List[ElementId](g_id_list)

#-----------------------АПИ ПАРАМЕТРЫ----------------------
"""-"""
#-----------------------РАБОЧИЕ ПАРАМЕТРЫ----------------------

rooms = UnwrapElement(IN[0])

#-----------------------РАБОЧИЕ ПАРАМЕТРЫ----------------------	
"""-"""
#-----------------------ТЕСТОВЫЕ ПАРАМЕТРЫ----------------------

test = []

#-----------------------ТЕСТОВЫЕ ПАРАМЕТРЫ----------------------
"""-"""
#-----------------------НАЧАЛО СКРИПТА----------------------

x = 0
if rooms == None:
	rooms = [0,0]

for room in rooms:
	x=__x__(x)+__x__(x)
#TransactionManager.Instance.EnsureInTransaction(doc)
#TransactionManager.Instance.TransactionTaskDone()
#-----------------------КОНЕЦ СКРИПТА----------------------

OUT = x
# ----------------------------------------
members_2 = Python()  # "Object.Members"; frozen; unwired: IN[0]
# ---------- members_2.python (14 lines) ----------
import clr

items = IN[0]
elementlist = list()

try:
	clr.AddReference('RevitAPI')
	from Autodesk.Revit.DB import *
	for item in items:
		elementlist.append(dir(UnwrapElement(item)))
except:
	for item in items:
		elementlist.append(dir(item))
OUT = elementlist
# ----------------------------------------
filteredElementCollector = Python()  # frozen; unwired: IN[0]
# ---------- filteredElementCollector.python (29 lines) ----------
if IN[1]:
	import clr
	
	# Import DocumentManager and TransactionManager
	clr.AddReference("RevitServices")
	import RevitServices
	from RevitServices.Persistence import DocumentManager
	
	
	# Import RevitAPI
	clr.AddReference("RevitAPI")
	import Autodesk
	from Autodesk.Revit.DB import *
	
	doc = DocumentManager.Instance.CurrentDBDocument
	uiapp = DocumentManager.Instance.CurrentUIApplication
	app = uiapp.Application
	
	from System.Collections.Generic import *
	
	
	#The inputs to this node will be stored as a list in the IN variable.
	dataEnteringNode = IN
	collector = FilteredElementCollector(doc)
	elements = collector.OfCategory(BuiltInCategory.OST_Views).ToElements()
	
	OUT = sheetInstances
else:
	OUT = "скрипт не выполнен"
# ----------------------------------------
параметр_отделки_стен_2 = StringInput("АБН_Площадь проёмов")  # graph input
getDocuments = archilab.Revit.Selection.Select.GetDocuments()
watch_3 = Watch(code_block_4.out0)
forceChildsEval_2 = ForceChildsEval(passObject_3=путь_к_файлу_python)  # unwired: passObject, passObject_2
toCuboid = BoundingBox.ToCuboid()  # unwired: boundingBox
forceChildsEval_3 = ForceChildsEval()  # unwired: passObject, passObject_2, passObject_3
select_model_elements = DSModelElementsSelection()  # 12 picked in the model
code_block_7 = CodeBlock(t1=select_model_elements) { boundingBox1 = Element.BoundingBox(t1); }
запуск_построения_геометрии = BoolSelector(true)  # graph input
code_block_8 = CodeBlock { null; }
if_2 = Python(IN[0]=запуск_построения_геометрии, IN[1]=code_block_4.out1, IN[2]=code_block_8)  # same code as if_
categories_3 = Categories("OST_Walls")  # graph input
byName = Material.ByName(name=code_block_4.out2)
code_block_9 = CodeBlock(name=code_block_4.out2) { name; }
byGeometry = DirectShape.ByGeometry(geometry=if_2, category=categories_3, material=byName, name=code_block_9)
параметр_отделки_элемента = StringInput("DS_finishing_area")  # graph input
setParameterByName_3 = Element.SetParameterByName(element=byGeometry, parameterName=параметр_отделки_элемента, value=convert_between_units)
параметр_отделки_элемента_2 = StringInput("ADSK_Номер квартиры")  # graph input
getParameterValueByName_2 = Element.GetParameterValueByName(element=watch, parameterName=параметр_отделки_элемента_2)
setParameterByName_4 = Element.SetParameterByName(element=setParameterByName_3, parameterName=параметр_отделки_элемента_2, value=getParameterValueByName_2)
параметр_этажа = StringInput("ADSK_Этаж")  # graph input
параметр_уровня = StringInput("Уровень")  # graph input
getParameterValueByName_3 = Element.GetParameterValueByName(element=watch, parameterName=параметр_уровня)
setParameterByName_5 = Element.SetParameterByName(element=setParameterByName_4, parameterName=параметр_этажа, value=getParameterValueByName_3)
параметр_этажа_2 = StringInput("Комментарии")  # graph input
setParameterByName_6 = Element.SetParameterByName(element=setParameterByName_5, parameterName=параметр_этажа_2, value=code_block_9)
translate = Geometry.Translate()  # unwired: geometry
select_model_element = DSModelElementSelection()  # 1 picked in the model
code_block_10 = CodeBlock(t1=select_model_element, t2=code_block_3) { geometry1 = Geometry.Rotate(t1, t2, t2, t2); geometry2 = Geometry.Translate(t1, t2); }
forceChildsEval_4 = ForceChildsEval(passObject_2=путь_к_файлу_python)  # unwired: passObject
rotate = Geometry.Rotate()  # unwired: geometry, origin, axis
transform = Geometry.Transform()  # unwired: geometry, fromCoordinateSystem, contextCoordinateSystem
translate_2 = Geometry.Translate()  # unwired: geometry, direction
